# Grasshopper definition growth2.gh (Grasshopper 1.0.7)
# plug-ins: Pufferfish, Kangaroo Components, PlanktonGh, Kangaroo2 Components, Weaverbird

unit_z = UnitZ(Factor=expr("0.5*x", "-6"))
point = Point(Point(425.2584972, 588.9390293, 23.33802357))
move = Move(Geometry=point, Motion=unit_z)  # -> Geometry, Transform
number_slider = Slider(9, range=0..100)
unit_z_2 = UnitZ(Factor=0.5)
circle = Circle(Plane=move.Geometry, Radius=Slider(2, range=0..10))
linear_array = LinearArray(Geometry=circle, Direction=unit_z_2, Count=number_slider)  # -> Geometry, Transform
series = Series(Start=0, Step="360/24", Count=number_slider)
rotate = Rotate(Geometry=linear_array.Geometry, Angle=degrees(series), Plane=move.Geometry)  # -> Geometry, Transform
divide_curve = DivideCurve(Curve=rotate.Geometry, Count="12", Kinks=False)  # -> Points, Tangents, Parameters
polyline = PolyLine(Vertices=divide_curve.Points, Closed=invert(False))  # -> flatten(Polyline)
parameter_loft_mesh = ParameterLoftMesh(
    Sections=polyline,
    ParametersU=[0, 0.1, 0.2, 0.3, 0.4, 0.5, 0.6, 0.7, 0.8, 0.9, 1],
    ParametersV=[0, 1],
    Weighted=False,
    Lengths=invert(False),
    Angle=0,
    Closed=False,
    Triangulate=invert(False))
shift_list = ShiftList(List=polyline, Shift="-6", Wrap=invert(True))
control_polygon = ControlPolygon(Curve=shift_list)  # -> Polygon, Points
shift_list_2 = ShiftList(List=control_polygon.Points, Shift=1, Wrap=invert(True))  # -> flatten(List)
mesh = Mesh(parameter_loft_mesh)
deconstruct_mesh = DeconstructMesh(Mesh=mesh)  # -> Vertices, Faces, Colours, Normals
closest_point = ClosestPoint(Point=deconstruct_mesh.Vertices, Cloud=shift_list_2)  # -> ClosestPoint, CPIndex, Distance
smaller_than = SmallerThan(FirstNumber=closest_point.Distance, SecondNumber="0.001")  # -> SmallerThan, OrEqualTo
mesh_naked_edges = MeshNakedEdges(Mesh=mesh)  # -> flatten(Naked), ResultBoolean
cull_vertices = CullVertices(Mesh=mesh, Pattern=invert(smaller_than.SmallerThan), Shrink=invert(True))
list_item = ListItem(List=mesh_naked_edges.Naked, Index=0, Wrap=True)
curve = Curve(list_item)
number_slider_2 = Slider(10, range=0..10)
number_slider_3 = Slider(0.1, range=0..1)
combine_clean = CombineClean(Meshes=mesh)
deconstruct_mesh_2 = DeconstructMesh(Mesh=combine_clean)  # -> Vertices, Faces, Colours, Normals
pull_point = PullPoint(Point=deconstruct_mesh_2.Vertices, Geometry=cull_vertices, ClosestOnly=True)  # -> ClosestPoint, Distance
pull_point_2 = PullPoint(Point=deconstruct_mesh_2.Vertices, Geometry=curve, ClosestOnly=True)  # -> ClosestPoint, Distance
reparameterize_numbers = ReparameterizeNumbers(Numbers=pull_point_2.Distance, Invert=invert(False))  # -> Reparameterized, Original
smaller_than_2 = SmallerThan(FirstNumber=pull_point.Distance, SecondNumber=Slider(0.001, range=0..0.001))  # -> SmallerThan, OrEqualTo

# ----
# Environmental Data
# Points
data = Data([-0.6984444261, -0.4541036487, -0.1433391869, 0.1714722961, 0.4339874387, 0.6146993637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])
point_2 = Point([Point(387.6964111, 530.5872192, 9.857050896), Point(387.6964111, 537.6421509, 9.857050896), Point(387.6964111, 544.697052, 9.857050896), Point(387.6964111, 551.7519531, 9.857050896), Point(387.6964111, 558.8068848, 9.857050896), Point(387.6964111, 565.8618164, 9.857050896)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])

graph_mapper = GraphMapper(
    reparameterize_numbers.Reparameterized,
    x0=0,
    x1=1,
    y0=0,
    y1=1,
    container_name="Polyline",
    pt=[Point(0, 0, 0), Point(0.4326026142, 0, 0), Point(0.7672829628, 0.03923410177, 0), Point(0.9283410907, 0.1477625966, 0), Point(1, 1, 0)])
reparameterize_numbers_2 = ReparameterizeNumbers(Numbers=data, Invert=False)  # -> Reparameterized, Original
bounds_2d = Bounds2D(Coordinates=point_2)
colour_rgb_f = ColourRGBF(Alpha=1, Red=graph_mapper, Green=graph_mapper, Blue=graph_mapper)
colour_rgb_f_2 = ColourRGBF(Alpha=1, Red=smaller_than_2.OrEqualTo, Green=smaller_than_2.OrEqualTo, Blue=smaller_than_2.OrEqualTo)
panel = Panel("0.001")
mesh_colours = MeshColours(Mesh=combine_clean, Colours=colour_rgb_f)
remap_numbers = RemapNumbers(Value=graph_mapper, Source=Domain(0, 1), Target="0.008")  # -> Mapped, Clipped
remap_numbers_2 = RemapNumbers(Value=graph_mapper, Source=Domain(0, 1), Target="1  to 0.8")  # -> Mapped, Clipped
mesh_2 = Mesh(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)
mesh_3 = Mesh(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)
graph_mapper_2 = GraphMapper(
    reparameterize_numbers_2.Reparameterized,
    x0=0,
    x1=1,
    y0=-0.4,
    y1=1,
    container_name="Sigmoid",
    e=0.2490411252,
    t0=-100,
    t1=100)
mesh_join = MeshJoin(Meshes=[mesh_3, mesh_2])
combine_clean_2 = CombineClean(Meshes=mesh_join)
trigger = Trigger(Interval=1, TimerInterval=5, Target=c_script)  # disabled
c_script = CSharpScript(
    data=graph_mapper_2,
    interval2d=bounds_2d,
    pmesh=combine_clean,
    colmesh=combine_clean_2,
    splitratio=Slider(0.1, range=0..1),
    decsentrate=0,
    targetlengths=remap_numbers_2.Mapped,
    growthrate=remap_numbers.Mapped,
    growthdecsent=Slider(0.98, range=0..1),
    isanchored=smaller_than_2.OrEqualTo,
    hingestrength=Slider(0.08, range=0..0.1),
    reset=Button(),
    viewnum=Slider(1, range=0..100),
    Reference=["C:\Program Files\Rhino 7\Plug-ins\Grasshopper\Components\KangarooSolver.dll", "C:\USERS\YANGW\APPDATA\ROAMING\GRASSHOPPER\LIBRARIES\KANGAROO0099\Plankton.dll", "C:\USERS\YANGW\APPDATA\ROAMING\GRASSHOPPER\LIBRARIES\KANGAROO0099\PlanktonGh.dll"])  # -> out, A, B, C, D, E, F; inputs xnum: Int32, ynum: Int32, data: list of Double, pmesh: Mesh, colmesh: Mesh, splitratio: Double, decsentrate: Double, targetlengths: list of Double, growthrate: list of Double, growthdecsent: Double, isanchored: list of Boolean, hingestrength: Double, reset: Boolean, viewnum: Int32
# ---------- c_script: C# usings ----------
using Plankton;
using PlanktonGh;
using KangarooSolver;
using KangarooSolver.Goals;
using System.Threading.Tasks;
using System.Linq;
# ---------- c_script: C# ----------
    //pre
    bool stop;
    double hingestr = hingestrength;
    double springstr = 1;
    double dist1 = 1;
    double dist2 = 1.5;
    double sr = splitratio >= 0 ? (splitratio <= 1 ? splitratio : 1) : 0;


    if(reset)
    {
      //edata
      edata = new double[xnum][];
      for(int i = 0;i < xnum;i++)
      {
        edata[i] = new double[ynum];
        for(int j = 0;j < ynum;j++)
        {
          edata[i][j] = data[j + i * ynum];
        }
      }
      xNum = xnum;yNum = ynum;
      uvDom = interval2d;

      colMesh = colmesh;

      tL = targetlengths;
      P = pmesh.ToPlanktonMesh();
      gR = growthrate;

      PSys = new KangarooSolver.PhysicalSystem();
      anchors = new List<IGoal>();
      springs = new List<IGoal>();
      hinges = new List<IGoal>();
      skip = new List<bool>();
      _counter = 0;
      int cc = 0;
      foreach(var v in P.Vertices)
      {
        var pt = v.ToPoint3d();
        var ee = Interpolate(pt);
        eR.Add(ee);
        PSys.AddParticle(pt, 10);
        if (!isanchored[cc] && ee > 0)
        {
          skip.Add(false);
        }
        else
        {
          IGoal anch = new AnchorXYZ(pt, true, true, true, 100);
          anch.PIndex = new int[1]{cc};
          anchors.Add(anch);
          skip.Add(true);
        }
        cc++;
      }

      for(int i = 0;i < P.Halfedges.Count / 2;i++)
      {
        var h = P.Halfedges[2 * i];
        var ph = P.Halfedges[2 * i + 1];
        int s = h.StartVertex;
        int e = ph.StartVertex;
        double length_now = (P.Vertices[s].ToPoint3d() - P.Vertices[e].ToPoint3d()).Length;
        IGoal spr = new Spring(s, e, length_now, springstr);
        springs.Add(spr);
        double a;
        int[] pts = GetHinge(2 * i, P, out a);
        if(h.AdjacentFace != -1 && ph.AdjacentFace != -1)
        {
          IGoal hin = new Hinge(pts[0], pts[1], pts[2], pts[3], 0, hingestr);
          hinges.Add(hin);
        }
        else
        {
          IGoal hin = new Hinge(pts[0], pts[1], pts[2], pts[3], 0, 0);
          hinges.Add(hin);
        }
      }
    }

    double t = 1;
    var counter = 0;
    var dr = decsentrate; dr = dr < 0.96 ? (dr < 0 ? 0 : dr) : 0.96;
    var gd = growthdecsent; gd = gd < 1 ? (gd < 0.6 ? 0.6 : gd) : 1;

    //run
    if(!reset)
    {
      //remesh start
      do
      {
        stop = true;
        var hs = P.Halfedges;
        var ec = hs.Count / 2;
        var el = hs.GetLengths();
        var vs = P.Vertices;
        for(int i = 0;i < ec;i++)
        {
          if (hs[2 * i].IsUnused == false)
          {
            int vStart = hs[2 * i].StartVertex;
            int vEnd = hs[2 * i + 1].StartVertex;
            //only when skip is false it executes splitting or collapse.
            //there are two reasons that it skips.
            //1: vertex is visited.
            //2: vertex position doesn't change a lot.
            if (!skip[vStart] || !skip[vEnd])
            {
              var tl = (tL[vStart] + tL[vEnd]) / 2;
              //split too long
              if(el[2 * i] > (1 + t) * 1.25f * tl)
              {
                int spe = hs.TriangleSplitEdge(2 * i);
                if(spe != -1)//succeed
                {
                  var g1 = gR[vStart] *= gd;
                  var g2 = gR[vEnd] *= gd;
                  var g3 = g1 > g2 ? g2 : g1;//minimum
                  var g4 = (g1 + g2) / 2;//average
                  var g5 = (1 - sr) * g3 + sr * g4;//somewhere between minimum and average
                  stop = false;
                  int spv = hs[spe].StartVertex;
                  skip.Add(false);
                  tL.Add(tl);
                  gR.Add(g5);

                  //add particle
                  var spt = vs[vStart].ToPoint3d();
                  var ept = vs[vEnd].ToPoint3d();
                  var mid = (spt + ept) / 2;
                  PSys.AddParticle(mid, 10);
                  eR.Add(Interpolate(mid));

                  //resize goals
                  int sizediff = hs.Count / 2 - springs.Count;
                  springs.AddRange(new Spring[sizediff]);
                  hinges.AddRange(new Hinge[sizediff]);
                  //loop add new & mark skip
                  IEnumerable <int> nhs = hs.GetVertexCirculator(spe);D = hs[spe].StartVertex;
                  foreach(var nh in nhs)
                  {
                    int edge = nh / 2;
                    double restangle;
                    int[] hpts = GetHinge(2 * edge, P, out restangle);
                    //hinge
                    if(P.Halfedges[nh].AdjacentFace != -1 && P.Halfedges[P.Halfedges.GetPairHalfedge(nh)].AdjacentFace != -1)
                    {
                      IGoal hin = new Hinge(hpts[0], hpts[1], hpts[2], hpts[3], 0, hingestr);
                      hinges[edge] = hin;
                    }
                    else
                    {
                      IGoal hin = new Hinge(hpts[0], hpts[1], hpts[2], hpts[3], 0, 0);
                      hinges[edge] = hin;
                    }

                    //spring
                    var lengthhere = vs[hpts[0]].ToPoint3d().DistanceTo(vs[hpts[1]].ToPoint3d());
                    IGoal spr = new Spring(hpts[0], hpts[1], lengthhere, springstr);
                    springs[edge] = spr;
                  }
                }
              }

            }
          }
        }
        P.Compact();

        hs = P.Halfedges;
        ec = hs.Count / 2;
        el = hs.GetLengths();
        vs = P.Vertices;
        //merge too short
        for(int i = 0;i < ec;i++)
        {
          if (hs[2 * i].IsUnused == false)
          {
            int vStart = hs[2 * i].StartVertex;
            int vEnd = hs[2 * i + 1].StartVertex;
            if (!skip[vStart] || !skip[vEnd])
            {
              var tl = (tL[vStart] + tL[vEnd]) / 2;
              if(el[2 * i] < (1 - t) * 0.25f * tl)
              {
                //store the index of edge to remove
                int next = hs[2 * i].NextHalfedge;
                int prev = hs[2 * i + 1].PrevHalfedge;
                int left = hs[2 * i].AdjacentFace;
                int right = hs[2 * i + 1].AdjacentFace;

                int clStart = hs[2 * i].StartVertex;
                int clEnd = hs[2 * i + 1].StartVertex;
                float x = (vs[clStart].X + vs[clEnd].X) / 2;
                float y = (vs[clStart].Y + vs[clEnd].Y) / 2;
                float z = (vs[clStart].Z + vs[clEnd].Z) / 2;
                var g1 = gR[clStart];
                var g2 = gR[clEnd];
                var g = g1 > g2 ? g1 : g2;
                int cle = hs.CollapseEdge(2 * i);
                if(cle != -1)
                {
                  stop = false;
                  vs.SetVertex(clStart, x, y, z);
                  tL[clStart] = tl;
                  gR[clStart] = g;
                  tL.RemoveAt(clEnd);
                  gR.RemoveAt(clEnd);

                  //remove
                  springs.RemoveAt(i);
                  hinges.RemoveAt(i);
                  PSys.DeleteParticle(clEnd);
                  if(left != -1)
                  {
                    springs.RemoveAt(next / 2);
                    hinges.RemoveAt(next / 2);
                  }
                  if(right != -1)
                  {
                    springs.RemoveAt(prev / 2);
                    hinges.RemoveAt(prev / 2);
                  }
                  //loop change p & mark skip
                  IEnumerable <int> nhs = hs.GetVertexCirculator(cle);
                  foreach(var nh in nhs)
                  {
                    int edge = nh / 2;
                    //hinge
                    hinges[edge].PIndex[0] = hinges[edge].PIndex[0] == clEnd ? clStart : hinges[edge].PIndex[0];
                    hinges[edge].PIndex[1] = hinges[edge].PIndex[1] == clEnd ? clStart : hinges[edge].PIndex[1];
                    hinges[edge].PIndex[2] = hinges[edge].PIndex[2] == clEnd ? clStart : hinges[edge].PIndex[2];
                    hinges[edge].PIndex[3] = hinges[edge].PIndex[3] == clEnd ? clStart : hinges[edge].PIndex[3];
                    //spring
                    springs[edge].PIndex[0] = springs[edge].PIndex[0] == clEnd ? clStart : springs[edge].PIndex[0];
                    springs[edge].PIndex[1] = springs[edge].PIndex[1] == clEnd ? clStart : springs[edge].PIndex[1];
                    //skip
                    skip[hs[hs.GetPairHalfedge(nh)].StartVertex] = true;
                  }
                }
              }
            }
          }
        }
        P.Compact();
        ec = hs.Count / 2;
        for(int i = 0; i < ec;i++)
        {
          if(!hs[2 * i].IsUnused
            && hs[2 * i].AdjacentFace != -1
            && hs[2 * i + 1].AdjacentFace != -1
            && hs[hs.GetPairHalfedge(hs[2 * i].NextHalfedge)].AdjacentFace != -1
            && hs[hs.GetPairHalfedge(hs[2 * i].PrevHalfedge)].AdjacentFace != -1
            && hs[hs.GetPairHalfedge(hs[2 * i + 1].NextHalfedge)].AdjacentFace != -1
            && hs[hs.GetPairHalfedge(hs[2 * i + 1].PrevHalfedge)].AdjacentFace != -1
            )
          {
            int v1 = hs[2 * i].StartVertex;
            int v2 = hs[2 * i + 1].StartVertex;
            int v3 = hs[hs[hs[2 * i].NextHalfedge].NextHalfedge].StartVertex;
            int v4 = hs[hs[hs[2 * i + 1].NextHalfedge].NextHalfedge].StartVertex;
            Point3d P1 = vs[v1].ToPoint3d();
            Point3d P2 = vs[v2].ToPoint3d();
            Point3d P3 = vs[v3].ToPoint3d();
            Point3d P4 = vs[v4].ToPoint3d();
            double A1 = Vector3d.VectorAngle(new Vector3d(P3 - P1), new Vector3d(P4 - P1))
              + Vector3d.VectorAngle(new Vector3d(P4 - P2), new Vector3d(P3 - P2));
            double A2 = Vector3d.VectorAngle(new Vector3d(P1 - P4), new Vector3d(P2 - P4))
              + Vector3d.VectorAngle(new Vector3d(P2 - P3), new Vector3d(P1 - P3));
            if (A2 > A1)
            {
              stop = false;
              P.Halfedges.FlipEdge(2 * i);

              //modify springs
              springs[i] = new Spring(v3, v4, P3.DistanceTo(P4), springstr);
              //modify hinges
              double a;
              GetHinge(2 * i, P, out a);
              hinges[i] = new Hinge(v3, v4, v2, v1, 0, hingestr);
            }
          }
        }
        stop = t > 0.05 ? false : stop;
        t *= dr;
        counter++;
      }while(!(stop) && counter < 101);Print("{0}", counter - 1);
      P.Compact();

      //growth start
      var goals = new List<IGoal>();
      for(int i = 0;i < P.Halfedges.Count / 2;i++)
      {
        Spring s = springs[i] as Spring;
        s.RestLength += (gR[s.PIndex[0]] + gR[s.PIndex[1]] ) * (eR[s.PIndex[0]] + eR[s.PIndex[1]] ) / 4; goals.Add((IGoal) s);
        Hinge hge = hinges[i] as Hinge;
        if(hge.Strength != 0){goals.Add((IGoal) hge);}
      }
      goals.AddRange(anchors);
      goals.Add(new GrowthPush(dist1, dist2, P));
      goals.Add(new MeshPush(P, colMesh, 0.5));
      PSys.Step(goals, true, 0.1);
      var particles = PSys.GetPositionArray();
      for(int n = 0;n < particles.Count();n++)
      {
        Vector3d sp = particles[n] - P.Vertices[n].ToPoint3d();
        eR[n] = Interpolate(particles[n]);
        //when growthrate<0.0001, stop growth
        if(!skip[n] && sp.Length < 0.0001 && gR[n] < 0.0001 || eR[n] < 0)
        {
          skip[n] = true;
          gR[n] = 0;
          IGoal anch = new AnchorXYZ(particles[n], true, true, true, 100);
          anch.PIndex = new int[1]{n};
          anchors.Add(anch);
        }
        P.Vertices.SetVertex(n, particles[n]);
      }
    }
    A = P;
    B = gR;
    C = _counter++;
    E = eR;
    F = skip;
# ---------- c_script: C# additional code ----------
  List<double> tL;//target length
  List<double> gR;//growth rate
  List<double> eR = new List<double>();
  List<bool> skip;
  PlanktonMesh P;
  Mesh colMesh;
  int _counter = 0;

  //edata
  double[][] edata;
  int xNum,yNum;
  UVInterval uvDom;
  //interpolaton
  public double Interpolate(Point3d pt)
  {
    var x = xNum * (pt.X - uvDom.U0) / uvDom.U.Length;
    int xx = x > 0 ? (x < xNum - 2 ? (int) x : xNum - 2) : 0;

    var y = yNum * (pt.Y - uvDom.V0) / uvDom.V.Length;
    int yy = y > 0 ? (y < yNum - 2 ? (int) y : yNum - 2) : 0;


    var y1 =
      edata[xx][yy] * (1 - x + xx)
      +
      edata[xx + 1][yy] * (x - xx);

    var y2 =
      edata[xx][yy + 1] * (1 - x + xx)
      +
      edata[xx + 1][yy + 1] * (x - xx);

    return
      y1 * (1 - y + yy)
      +
      y2 * (y - yy);
  }

  //physics
  KangarooSolver.PhysicalSystem PSys;
  List<IGoal> springs;
  List<IGoal> hinges;
  List<IGoal> anchors;

  public int[] GetHinge(int h, PlanktonMesh p, out double a)
  {
    int[] output = new int[4];

    output[0] = p.Halfedges[h].StartVertex;
    Point3d P0 = p.Vertices[p.Halfedges[h].StartVertex].ToPoint3d();

    int ph = p.Halfedges.GetPairHalfedge(h);
    output[1] = p.Halfedges[ph].StartVertex;
    Point3d P1 = p.Vertices[p.Halfedges[ph].StartVertex].ToPoint3d();

    int php = p.Halfedges[ph].PrevHalfedge;
    output[2] = p.Halfedges[php].StartVertex;
    Point3d P2 = p.Vertices[p.Halfedges[php].StartVertex].ToPoint3d();

    int hp = p.Halfedges[h].PrevHalfedge;
    output[3] = p.Halfedges[hp].StartVertex;
    Point3d P3 = p.Vertices[p.Halfedges[hp].StartVertex].ToPoint3d();

    Vector3d V01 = P1 - P0;
    Vector3d V02 = P2 - P0;
    Vector3d V03 = P3 - P0;

    Vector3d Cross0 = Vector3d.CrossProduct(V02, V01);
    Vector3d Cross1 = Vector3d.CrossProduct(V01, V03);

    double temp = Vector3d.VectorAngle(Cross0, Cross1, new Plane(P0, V01));
    if (temp > Math.PI) { temp -= 2 * Math.PI; }
    a = temp;
    return output;
  }




  //this class of instance refresh in every iteration.
  public class GrowthPush:GoalObject
  {
    public double Strength = 1;
    public double SqrPushDist1;
    public double SqrPushDist2;
    public double PushDist1;
    public double PushDist2;
    PlanktonMesh Pm;


    private bool CheckNeighbor(int v1, int v2)
    {
      IEnumerable <int> nhs = Pm.Halfedges.GetVertexCirculator(Pm.Vertices[v1].OutgoingHalfedge);
      foreach( var nh in nhs)
      {
        if (Pm.Halfedges[Pm.Halfedges[nh].NextHalfedge].StartVertex == v2)
        {return true;}
      }
      return false;
    }


    //GrowthPush
    public GrowthPush(double dist1, double dist2, PlanktonMesh pm)
    {
      //base
      PIndex = Enumerable.Range(0, pm.Vertices.Count).ToArray();
      int num = PIndex.Length;
      Move = new Vector3d[num];
      Weighting = new double[num];
      for (int i = 0; i < num; i++)
      {
        Weighting[i] = Strength;
      }
      //this
      SqrPushDist1 = dist1 * dist1;
      SqrPushDist2 = dist2 * dist2;
      PushDist1 = dist1;
      PushDist2 = dist2;
      Pm = pm;
    }

    public override void Calculate(List < KangarooSolver.Particle > p)
    {
      int num = PIndex.Length;
      double[] Zcoord = new double[num];

      for (int i = 0; i < num; i++)
      {
        Zcoord[i] = p[PIndex[i]].Position.Z;
        Move[i] = Vector3d.Zero;
      }
      Array.Sort(Zcoord, PIndex);


      Parallel.For(0, PIndex.Length - 1, i =>
        {
        for (int j = 1; (i + j) < PIndex.Length; j++)
        {
          int k = i + j;
          int ind1 = PIndex[k];
          int ind2 = PIndex[i];
          bool isPair = CheckNeighbor(ind1, ind2);
          Vector3d Sp = p[ind1].Position - p[ind2].Position;
          if(isPair)
          {
            if (Sp.Z < PushDist1)
            {
              for(var sl = Sp.SquareLength;sl < SqrPushDist1;)
              {
                var l = Math.Sqrt(sl);
                double factor = 1 - PushDist1 / l;
                Vector3d dmove = 0.1 * Sp * factor;
                Move[i] += dmove;
                Move[k] -= dmove;
                break;
              }
            }
            else { break; }
          }
          else
          {
            if (Sp.Z < PushDist2)
            {
              for(var sl = Sp.SquareLength;sl < SqrPushDist2;)
              {
                var l = Math.Sqrt(sl);
                double factor = 1 - PushDist2 / l;
                Vector3d dmove = 0.1 * Sp * factor;
                Move[i] += dmove;
                Move[k] -= dmove;
                break;
              }
            }
            else { break; }
          }
        }
        });

    }
  }
  //MeshPush
  public class MeshPush : GoalObject
  {

    public double Strength = 1;
    PlanktonMesh Pm;
    Mesh M;
    double Dist;
    double SquareDist;

    public MeshPush(PlanktonMesh pm, Mesh m, double dist)
    {
      //base
      PIndex = Enumerable.Range(0, pm.Vertices.Count).ToArray();
      int num = PIndex.Length;
      Move = new Vector3d[num];
      Weighting = new double[num];
      for (int i = 0; i < num; i++)
      {
        Weighting[i] = Strength;
      }
      //this
      Pm = pm;M = m;SquareDist = dist * dist;Dist = dist;
    }

    public override void Calculate(List < KangarooSolver.Particle > p)
    {
      Parallel.For(0, PIndex.Length, i =>
        {
        Point3d ThisPt = p[PIndex[i]].Position;
        var MP = M.ClosestMeshPoint(ThisPt, 1000);
        var Push = MP.Point - ThisPt;
        var sl = Push.SquareLength;
        if(sl < SquareDist)
        {
          var l = Math.Sqrt(sl);
          double factor = 1 - Dist / l;
          Vector3d dmove = 0.5 * Push * factor;
          Move[i] = dmove;
        }
        });
    }
  }
# ---------- end c_script ----------
panel_2 = Panel(" diffeernent senario")
reparameterize_numbers_3 = ReparameterizeNumbers(Numbers=c_script.B, Invert=False)  # -> Reparameterized, Original
hhhhh = Panel(c_script.C)
multiplication = Multiplication(A=c_script.B, B=c_script.E)
panel_3 = Panel(c_script.D)
panel_4 = Panel(c_script.B)
cull_pattern = CullPattern(List=reparameterize_numbers_3.Reparameterized, CullPattern=c_script.F)
reparameterize_numbers_4 = ReparameterizeNumbers(Numbers=c_script.E, Invert=False)  # -> Reparameterized, Original
panel_5 = Panel("3180")
panel_6 = Panel("554")
panel_7 = Panel(multiplication)
planktonmesh = PlanktonMesh(c_script.A)
list_length = ListLength(List=reparameterize_numbers_3.Reparameterized)
list_length_2 = ListLength(List=cull_pattern)
addition = Addition(A=reparameterize_numbers_4.Reparameterized, B=Slider(0.2, range=0..1))
subtraction = Subtraction(A=1, B=reparameterize_numbers_4.Reparameterized)
mesh_4 = Mesh(planktonmesh)
panel_8 = Panel(list_length_2)
colour_rgb_f_3 = ColourRGBF(Alpha=1, Red=addition, Green=reparameterize_numbers_3.Reparameterized, Blue=subtraction)
mesh_colours_2 = MeshColours(Mesh=mesh_4, Colours=colour_rgb_f_3)
panel_9 = Panel(list_length)
subtraction_2 = Subtraction(A=panel_9, B=panel_8)
panel_10 = Panel(subtraction_2)
weaverbird_s_loop_subdivision = WeaverbirdsLoopSubdivision(MeshCurves=mesh_colours_2, Level=1, SmoothNakedEdges=2)
face_boundaries = FaceBoundaries(Mesh=weaverbird_s_loop_subdivision)
custom_preview = CustomPreview(
    Geometry=weaverbird_s_loop_subdivision,
    Material={diffuse=RGB(221, 160, 221), emission=RGB(66, 48, 66), shine=0.5, specular=RGB(255, 255, 255), transparency=0})
custom_preview_2 = CustomPreview(Geometry=face_boundaries, Material=ColourSwatch(SwatchColor=RGB(80, 0, 89)))
